# Grasshopper definition virtualAgent.gh (Grasshopper 1.0.7)
# plug-ins: MetaHopper, Kangaroo2 Components, Firefly.Core

toggle = BooleanToggle(True)
timer = Timer(TimerInterval=20, Target=read)
baudrate = Slider(9600, range=9600..115200)
portnumber = Slider(14, range=0..14)
read = SerialReadGeneric(StartReadingValues=toggle, PortNumber=portnumber)  # -> SerialOutput, StatusMessage
number_slider = Slider(31, range=31..150)
open_port = OpenClosePort(OpenClosePort=toggle, PortNumber=portnumber, BaudRate=baudrate)
# Nothing
# Knock
# Slide
# Max Knock
# Reset max Knock
panel = Panel(read.SerialOutput)
panel_2 = Panel(read.StatusMessage)
location = Location([Point(13.49111713, 10.24463149, -1.270122333), Point(6.601143301, 19.24791406, -1.196043686), Point(26.30762263, 16.41885265, -0.8531271512)])
pop3d = Populate3D(
    Region={Plane=PlaneXY(10.27532059, 14.59184991, 0), X=Domain(0, 7.0788793), Y=Domain(0, 6.512568956), Z=Domain(-1.975399936, 0)},
    Count=1000,
    Seed=1)
R = Radius(0.5)
panel_3 = Panel(open_port)
rectangle = Rectangle(Plane=PlaneXY(0, 0, 0), XSize=number_slider, YSize=number_slider, Radius=0)  # -> Rectangle, Length
Z = UnitZ(Factor=-0.01)
mesh = Mesh(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)
# used to get rid of (annoying!) second row printed
split = TextSplit(Text=panel)
panel_4 = Panel(split)
floor = Floor(Strength=10)
anchor = Anchor(Point=location, Strength=10000)
spc = SolidPointCollide(Points=pop3d, Solid=mesh, Interior=False, Unidirectional=True, Strength=6)
sc = SphereCollide(Points=pop3d, Radius=R, Strength=1)
load = Load(Point=pop3d, ForceVector=Z)
item = ListItem(List=split, Index=0, Wrap=True)
panel_5 = Panel(item)
end = EndPoints(Curve=rectangle.Rectangle)  # -> Start, End
# gesture = knock + stop knock
length_line = LengthLine(Length=rectangle.Rectangle, Strength=10)
X = UnitX(Factor=1)
col = Colour()
load_2 = Load(Point=[end.Start, end.End], ForceVector=X)
split_2 = TextSplit(Text=item, Separators=",")
panel_6 = Panel(split_2)
gesture = ListItem(List=panel_6, Index=0, Wrap=True)
rotate = ListItem(List=panel_6, Index=2, Wrap=True)
fraction = ListItem(List=panel_6, Index=3, Wrap=True)
dpath = DeconstructPath(Branch=rotate)
dpath_2 = DeconstructPath(Branch=gesture)
expression = Expression(x=dpath_2, Expression="If(x=1, False, True)")
panel_7 = Panel(expression)
# send 'Reset' = false when increasing the fractions amount, and then 'true' after ~0.5 sec
solver_bouncy = SolverBouncy(GoalObjects=[load_2, length_line], Reset=panel_7, Threshold=1e-15, Tolerance=0.01, Damping=0.99, Iterations=10, On=True)  # -> I, V, O
dpath_3 = DeconstructPath(Branch=fraction)
panel_8 = Panel(gesture)
expression_2 = Expression(x=dpath_2, Expression="if (x=3, true, false)")
filter1 = StreamFilter(Gate=expression_2, Stream0=col, Stream1="pink")
# change the toggle value when:
# A. ceilling is completly broken (max value)
# B.when removing-nailed gesture was preformed *and* background is already blue
panel_9 = Panel("gesture = MAX knock")
expression_3 = Expression(x=expression_2, Expression="not x")
number_of_glass_break = ListItem(List=panel_6, Index=1, Wrap=True)
onoff = EnableDisableObject(
    Enabled=expression_3,
    AllObjects_Object=[number_slider, extr, Z_2, cap, pop3d_2, number_slider_3, voronoi³, scale, crv, crv_cp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])
number_slider_2 = Slider(4, range=1..7)
panel_10 = Panel(number_of_glass_break)
Z_2 = UnitZ(Factor=number_slider_2)
# used to change numerical-text to number
item_2 = ListItem(List=number_of_glass_break, Index=0, Wrap=True)
panel_11 = Panel(item_2)
# increase the count value when new knocking gesture was preformed
number_slider_3 = Slider(5, range=0..10)
extr = Extrude(Base=rectangle.Rectangle, Direction=Z_2)
cap = CapHoles(Brep=extr)
dpath_4 = DeconstructPath(Branch=item_2)
expression_4 = Expression(x=dpath_2, y=dpath_4, Expression="if (x=4, true, false)")
B = Bomb(Location=location, Points=pop3d, DetonationTime=[150, 250, 350], Strength=1, Reset=expression_4)
bouncysolver = BouncySolver(
    GoalObjects=[sc, floor, load, B, anchor, spc],
    Reset=expression_4,
    Threshold=1e-15,
    Tolerance=0.01,
    Damping=0.9996,
    Iterations=2,
    On=expression_2)  # -> I, V, O
bang = ExplodeTree(Data=bouncysolver.V)  # -> _00000, Branch1
vb = VBScript(Pt=bang._00000, Style=3, Size=4, PtColor=filter1)  # -> out; inputs Pt: list of Point3d
# ---------- vb: VB usings ----------
Imports System.IO
Imports System.Linq
Imports System.Data
Imports System.Drawing
Imports System.Reflection
Imports System.Windows.Forms
Imports System.Xml
Imports System.Xml.Linq
Imports Microsoft.VisualBasic
Imports System.Runtime.InteropServices

Imports Rhino.DocObjects
Imports Rhino.Collections
Imports GH_IO
Imports GH_IO.Serialization
# ---------- vb: VB ----------
    ' original by David Rutten, see http://www.grasshopper3d.com/forum/topics/point-visualization
    ' some modifications Feb. 2013 by Stefan Spreng
    ' for point types see also http://4.rhino3d.com/5/rhinocommon/html/T_Rhino_Display_PointStyle.htm
    ' for color options see http://msdn.microsoft.com/en-us/library/14w97wkc
    
    
    If (m_display IsNot Nothing) Then
      m_display.Clear()
      m_display.Dispose()
      m_display = Nothing
    End If


    m_display = New Rhino.Display.CustomDisplay(True)
    m_display.AddPoints(Pt, Color.FromName(PtColor), Style, Size)
# ---------- vb: VB additional code ----------
  Private Shared m_display As Rhino.Display.CustomDisplay
# ---------- end vb ----------
geo = Geometry(bang._00000)
preview = CustomPreview(Geometry=geo, Material="Z:\Shirley\hci\17-02-21\Glass3.rmtl")
panel_12 = Panel(dpath_4)
# the minimum value to send as 'number of glass pieces' should be 2.
# so if we get 0, we send 2
panel_13 = Panel("gesture = knock")
expression_5 = Expression(x=dpath_4, Expression="If(x=0, 2, x)")
crv = Curve(<curve referenced from the Rhino model>)
int = Integer(-60)
expression_6 = Expression(z=dpath_2, x=dpath_3, y=expression_5, Expression="If(z=2, If(x<2, 2, x), y)")
pop3d_2 = Populate3D(Region=cap, Count=expression_6, Seed=number_slider_3)
crv_cp = CurveClosestPoint(Point=pop3d_2, Curve=crv)  # -> Point, Parameter, Distance
sort = SortList(Keys=flatten(crv_cp.Distance))  # -> reverse(Keys), ValuesA
panel_14 = Panel(sort.Keys)
int_2 = Integer(150)
item_3 = ListItem(List=sort.Keys, Index=solver_bouncy.I, Wrap=True)
division = Division(A=crv_cp.Distance, B=item_3)
voronoi³ = Voronoi3D(Points=pop3d_2)  # -> Cells, Boundary
graph = GraphMapper(
    division,
    x0=0,
    x1=1,
    y0=0,
    y1=1,
    container_name="Bezier",
    cpx=[0, 0, 1, 1],
    cpy=[0.9901960492, 0.7205882072, 0.5686274767, 1])
Z_3 = UnitZ(Factor=int_2)
X_2 = UnitX(Factor=int)
rectangle_2 = Rectangle(Plane=PlaneXY(0, 0, 0), XSize=int_2, YSize=int_2, Radius=0)  # -> Rectangle, Length
move = Move(Geometry=rectangle_2.Rectangle, Motion=X_2)  # -> Geometry, Transform

styletoggle1 = Slider(0, range=0..0.1)
timer_2 = Timer(TimerInterval=200, Target=python)
python = GhPythonScript()  # -> out, a
# ---------- python: Python ----------
__author__ = "Zohar Hen"
__version__ = "2021.02.07"

import rhinoscriptsyntax as rs
import Grasshopper as gh
from collections import deque

#  Number of demos
demos = 3


if "carussal" not in globals():
    carussal = deque(range(demos))

carussal.rotate(-1)
for obj in ghenv.Component.OnPingDocument().Objects:
    if obj.NickName == "StyleToggle1":
        if type(obj) is gh.Kernel.Special.GH_NumberSlider:
            obj.Slider.Value = carussal[0]
            obj.ExpireSolution(True)
# ---------- end python ----------

X_3 = UnitX(Factor=styletoggle1)
# ENABLE BOTH TIMERS!!!
# DO NOT FORGET
move_2 = Move(Geometry=rectangle_2.Rectangle, Motion=X_3)  # -> Geometry, Transform
list = ValueList({"Simple": 0, "ControlPoint": 1, "ActivePoint": 2, "X": 3}, selected="Simple")

styletoggle = Slider(0, range=0..1)
timer_3 = Timer(TimerInterval=500, Target=python_2)
python_2 = GhPythonScript()  # -> out, a
# ---------- python_2: Python ----------
__author__ = "Zohar Hen"
__version__ = "2021.02.07"

import rhinoscriptsyntax as rs
import Grasshopper as gh
from collections import deque

#  Number of demos
demos = 2


if "carussal" not in globals():
    carussal = deque(range(demos))

carussal.rotate(-1)
for obj in ghenv.Component.OnPingDocument().Objects:
    if obj.NickName == "StyleToggle":
        if type(obj) is gh.Kernel.Special.GH_NumberSlider:
            obj.Slider.Value = carussal[0]
            obj.ExpireSolution(True)
# ---------- end python_2 ----------

extr_2 = Extrude(Base=[move.Geometry, move_2.Geometry], Direction=Z_3)
scale = Scale(Geometry=voronoi³.Cells, Center=pop3d_2, Factor=graph)  # -> Geometry, Transform
panel_15 = Panel(graph)
panel_16 = Panel("Z:\Shirley\hci\17-02-21\Glass3.rmtl")
panel_17 = Panel("gesture = slide")
area = Area(Geometry=scale.Geometry)  # -> Area, Centroid
rad = Radians(Degrees=dpath)
int_3 = Integer(4)
int_4 = Integer(2)
pop3d_3 = Populate3D(Region=extr_2, Count=100, Seed=int_3)
rotate_2 = Rotate(Geometry=scale.Geometry, Angle=rad, Plane=area.Centroid)  # -> Geometry, Transform
preview_2 = CustomPreview(Geometry=rotate_2.Geometry, Material=panel_16)
filter = StreamFilter(Gate=styletoggle, Stream0="gray", Stream1="white")

# ---- group: Define A and B list sizes
first_list_length = Slider(29, range=0..50)
second_list_length = Slider(50, range=0..50)

# ----
int_5 = Integer(1)

# ---- group: Split data into 3 lists
partition = PartitionList(List=pop3d_3, Size=flatten([first_list_length, second_list_length]))  # -> reverse(simplify(Chunks))
bang_2 = ExplodeTree(Data=partition)  # -> Branch0, Branch1, Branch2, Branch3, Branch4, Branch5

# ----
vb_2 = VBScript(Pt=bang_2.Branch5, Style=list, Size=int_4, PtColor="white")  # -> out; inputs Pt: list of Point3d; same code as vb
vb_3 = VBScript(Pt=[pop3d_3, bang_2.Branch1], Style=list, Size=int_5, PtColor=filter)  # -> out; inputs Pt: list of Point3d
# ---------- vb_3: VB ----------
    ' original by David Rutten, see http://www.grasshopper3d.com/forum/topics/point-visualization
    ' some modifications Feb. 2013 by Stefan Spreng
    ' for point types see also http://4.rhino3d.com/5/rhinocommon/html/T_Rhino_Display_PointStyle.htm
    ' for color options see http://msdn.microsoft.com/en-us/library/14w97wkc

    If (m_display IsNot Nothing) Then
      m_display.Clear()
      m_display.Dispose()
      m_display = Nothing
    End If

    m_display = New Rhino.Display.CustomDisplay(True)
    m_display.AddPoints(Pt, Color.FromName(PtColor), Style, Size)
# ---------- vb_3: VB additional code ----------
  Private Shared m_display As Rhino.Display.CustomDisplay
# ---------- end vb_3 ----------
int_6 = Integer(2)
vb_4 = VBScript(Pt=bang_2.Branch3, Style=list, Size=int_6, PtColor="gray")  # -> out; inputs Pt: list of Point3d; same code as vb
